# Grasshopper definition sectiondrawer.gh (Grasshopper 0.9.76)
# plug-ins: Python Interpreter, Human UI

# ---- group: 切断線
crv = Curve(reparameterize(<curve referenced from the Rhino model>))

# ----
pt = Point(<point referenced from the Rhino model>)
panel = Panel("""main
debug""")
launchwin = LaunchWindow(
    Show=Toggle(True),
    Name="Plan&Section",
    Width=Slider(370, range=0..1000),
    Height=Slider(690, range=0..1000),
    ChildStatus=0,
    EnableHorizScroll=False)
accent_colors = ValueList({"Amber", "Blue", "Brown", "Cobalt", "Crimson", "Cyan", "Emerald", "Green", "Indigo", "Lime", "Magenta", "Mauve", "Olive", "Orange", "Pink", "Purple", "Red", "Sienna", "Steel", "Taupe", "Teal", "Violet", "Yellow"}, selected="Amber")
radiobtn = CreateRadioButton(RadioButtonName="屋根伏図(断面位置図)", RadioButtonGroup="モード選択", InitiallySelected=False)
radiobtn_2 = CreateRadioButton(RadioButtonName="平面図のみ", RadioButtonGroup="モード選択", InitiallySelected=True)
radiobtn_3 = CreateRadioButton(RadioButtonName="断面図のみ", RadioButtonGroup="モード選択", InitiallySelected=False)
radiobtn_4 = CreateRadioButton(RadioButtonName="平面図＆断面図", RadioButtonGroup="モード選択", InitiallySelected=False)
winprops = SetWindowProperties(Window=launchwin, Theme=0, AccentColor=accent_colors, ShowTitleBar=True, ScaleFactor=1)
stack = CreateStack(UIElements=[radiobtn_2, radiobtn_3], Horizontal=True)
values = ValueListener(Elements=radiobtn, SomeProperty=True)  # -> Values, Indices
values_2 = ValueListener(Elements=radiobtn_2, SomeProperty=True)  # -> Values, Indices
stack_2 = CreateStack(UIElements=[radiobtn_4, radiobtn], Horizontal=True)
values_3 = ValueListener(Elements=radiobtn_3, SomeProperty=True)  # -> Values, Indices
values_4 = ValueListener(Elements=radiobtn_4, SomeProperty=True)  # -> Values, Indices
toggle = BooleanToggle(True)
toggle_2 = BooleanToggle(False)
merge = Merge(Data1=values_2.Values, Data2=values_3.Values, Data3=values_4.Values, Data4=values.Values)
merge_2 = Merge(Data1=toggle, Data2=toggle)
merge_3 = Merge(Data1=toggle, Data2=toggle_2)
merge_4 = Merge(Data1=toggle_2, Data2=toggle)
merge_5 = Merge(Data1=toggle_2, Data2=toggle_2)
mindex = MemberIndex(Set=merge, Member=Toggle(True))  # -> Index, Count
filter = StreamFilter(Gate=mindex.Index, Stream0=merge_3, Stream1=merge_4, Stream2=merge_2, Stream3=merge_5)
crv_2 = Curve(crv)
item = ListItem(List=filter, Index=0, Wrap=True)  # -> Item, Item1
radiobtn_5 = CreateRadioButton(RadioButtonName="精度優先", RadioButtonGroup="スピード選択", InitiallySelected=False)
radiobtn_6 = CreateRadioButton(RadioButtonName="速度優先", RadioButtonGroup="スピード選択", InitiallySelected=True)
bool = Boolean(item.Item)
bool_2 = Boolean(item.Item1)
サーフェスの大きさ = Slider(50000, range=-1..1000000)
lng = ListLength(List=crv_2)
values_5 = ValueListener(Elements=radiobtn_6, SomeProperty=True)  # -> Values, Indices
values_6 = ValueListener(Elements=radiobtn_5, SomeProperty=True)  # -> Values, Indices
stack_3 = CreateStack(UIElements=[radiobtn_6, radiobtn_5], Horizontal=True)
end = EndPoints(Curve=crv_2)  # -> Start, End
目印の大きさ = Slider(29, range=5..100)
series = Series(Start=0, Step=1, Count=lng)
panel_2 = Panel("""dwg
3dm""")
merge_6 = Merge(Data1=graft(end.Start), Data2=graft(end.End))
int = Integer(series)
merge_7 = Merge(Data1=values_5.Values, Data2=values_6.Values)
panel_3 = Panel("""slow
fast""")
slider = CreateSlider(
    Slider=サーフェスの大きさ,
    SnapValue=Slider(10000, range=0..10000),
    ShowBounds=False,
    showLabel=False,
    ShowTicks=False,
    ShowTooltip=False,
    ShowValLabel=False)
tag = TextTag3D(Location=merge_6, Text=graft(int), Size=Slider(4010, range=0..4010), Justification=7)
toggle_3 = CreateToggle(Default=False, OnLabel=" on", OffLabel=" off")
mindex_2 = MemberIndex(Set=merge_7, Member=Toggle(False))  # -> Index, Count
textbox = CreateTextBox(DefaultText="-1500/0/1500", UpdateButton=True, showLabel=True)
textbox_2 = CreateTextBox(DefaultText="project", UpdateButton=True, showLabel=False)
filepicker = CreateFilePicker(ButtonLabelText="browse", DialogType=2, MustExist=True, Filter="All Files|*.*")
tb = CreateTextBlock(Text="□実行ーーーーーーーーーーーーーーーーーーーーーーーーーーー", TextSize=16, Justification=0)
tb_2 = CreateTextBlock(Text="□設定ーーーーーーーーーーーーーーーーーーーーーーーーーー", TextSize=16, Justification=0)
pulldown = CreatePulldownMenu(ListItems=panel_2, showLabel=True)
expander = CreateExpander(UIElements=slider, Header="目印の大きさ", Open=False)
tb_3 = CreateTextBlock(Text="共に英数字のみ使用可能", TextSize=12, Justification=0)
tb_4 = CreateTextBlock(Text="□断面図ーーーーーーーーーーーーーーーーーーーーーーーーー", TextSize=16, Justification=0)
slider_2 = CreateSlider(Slider=目印の大きさ, ShowBounds=False, showLabel=False, ShowTicks=False, ShowTooltip=False, ShowValLabel=False)
tb_5 = CreateTextBlock(Text="□平面図ーーーーーーーーーーーーーーーーーーーーーーーーー", TextSize=16, Justification=0)
tb_6 = CreateTextBlock(Text="□モード選択ーーーーーーーーーーーーーーーーーーーーーーー", TextSize=16, Justification=0)
values_7 = ValueListener(Elements=slider, SomeProperty=True)  # -> Values, Indices
expander_2 = CreateExpander(UIElements=textbox_2, Header="保存名", Open=False)
item_2 = ListItem(List=panel_3, Index=mindex_2.Index, Wrap=True)
expander_3 = CreateExpander(UIElements=filepicker, Header="保存先", Open=False)
expander_4 = CreateExpander(UIElements=textbox, Header="高さの指定", Open=False)
expander_5 = CreateExpander(UIElements=pulldown, Header="保存形式", Open=False)
values_8 = ValueListener(Elements=pulldown, SomeProperty=True)  # -> Values, Indices
expander_6 = CreateExpander(UIElements=slider_2, Header="目印の大きさ", Open=False)
hideshow = HideShowElement(ElementToHideShow=tb_4, Show=bool_2, Collapse=True, Disable=False)
txt = Text(item_2)
hideshow_2 = HideShowElement(ElementToHideShow=expander_4, Show=bool, Collapse=True, Disable=False)
hideshow_3 = HideShowElement(ElementToHideShow=expander, Show=bool, Collapse=True, Disable=False)
hideshow_4 = HideShowElement(ElementToHideShow=tb_5, Show=bool, Collapse=True, Disable=False)
values_9 = ValueListener(Elements=toggle_3, SomeProperty=True)  # -> Values, Indices
tb_7 = CreateTextBlock(Text="offにしてください", TextSize=12, Justification=0)
dam = DataDam(DataA=values_7.Values, BufferDelay=10000000, BufferMode=2)
setslider = SetSlider(UISlider=slider, Value=values_7.Values)
bool_3 = Boolean(values_9.Values)
adjustelem = AdjustElementAppearance(
    ElementsToAdjust=tb_7,
    Foreground=ColourSwatch(SwatchColor=RGB(255, 255, 255)),
    Background=ColourSwatch(SwatchColor=RGB(255, 0, 0)))
hideshow_5 = HideShowElement(ElementToHideShow=tb_7, Show=bool_3, Collapse=True, Disable=False)
adjustelem_2 = AdjustElementAppearance(ElementsToAdjust=[tb, tb_5, tb_4, tb_2, tb_6], Foreground=ColourSwatch(SwatchColor=RGB(196, 134, 0)))
hideshow_6 = HideShowElement(ElementToHideShow=expander_6, Show=bool_2, Collapse=True, Disable=False)
adjustpos = AdjustElementPositioning(
    ElementsToAdjust=filepicker,
    Margin=Slider(4, range=0..100),
    AbsolutePositioning=False,
    Width=Slider(300, range=0..1000),
    Height=Slider(35, range=0..1000),
    HorizontalAlignment=0)
adjustpos_2 = AdjustElementPositioning(
    ElementsToAdjust=[expander, expander_6, expander_4, expander_2, expander_3, expander_5],
    Margin=Slider(4, range=0..10),
    AbsolutePositioning=False,
    Width=Slider(320, range=0..1000),
    HorizontalAlignment=0)
adjustpos_3 = AdjustElementPositioning(
    ElementsToAdjust=[textbox_2, textbox],
    AbsolutePositioning=False,
    Width=Slider(300, range=0..1000),
    Height=Slider(27, range=0..1000),
    HorizontalAlignment=0)
values_10 = ValueListener(Elements=slider_2, SomeProperty=True)  # -> Values, Indices
values_11 = ValueListener(Elements=textbox_2, SomeProperty=True)  # -> Values, Indices
values_12 = ValueListener(Elements=filepicker, SomeProperty=True)  # -> Values, Indices
values_13 = ValueListener(Elements=textbox, SomeProperty=True)  # -> Values, Indices
dam_2 = DataDam(DataA=values_10.Values, BufferDelay=10000000, BufferMode=2)
setslider_2 = SetSlider(UISlider=slider_2, Value=values_10.Values)
split = TextSplit(Text=values_13.Values, Separators="/")
len = TextLength(Text=values_12.Values)
int_2 = Integer(split)
equals = Equality(FirstNumber=len, SecondNumber="0")  # -> Equality, Inequality
filter_2 = StreamFilter(Gate=equals.Equality, Stream0=values_12.Values, Stream1="D:\default\")
concat = Concatenate(FragmentA=filter_2, FragmentB="\")
data = Data(dam)
division = Division(A=data, B=2)
neg = Negative(Value=division)
dom = ConstructDomain(DomainStart=division, DomainEnd=neg)
file = ReadFile(File="D:\python\sectiondrawer\sectiondrawer\sectiondrawer.py", PerLineParse=False)
python = PythonScript(
    Code=file,
    Point_p=pt,
    Curve_s=crv,
    Mode=mindex.Index,
    Height=int_2,
    Directory=concat,
    Name=values_11.Values,
    Speed=txt,
    Draw=bool_3,
    Extension=values_8.Values,
    Mark=dam_2)  # -> Out, Direction, Center, Len_p, Len_s
panel_4 = Panel(python.Out)
txt_2 = Text(python.Len_p)
len_2 = TextLength(Text=txt_2)
nullrep = ReplaceNulls(Items=len_2, Replacements=0)  # -> Items, Count
eval = Evaluate(F="if(x=0, \"0\", \"1\")", x=nullrep.Items)
txt_3 = Text(python.Len_s)
filter_3 = StreamFilter(Gate=eval, Stream0="基準点が選択されていません", Stream1=txt_2)
len_3 = TextLength(Text=txt_3)
nullrep_2 = ReplaceNulls(Items=len_3, Replacements=0)  # -> Items, Count
join = TextJoin(Text=python.Out)
tb_8 = CreateTextBlock(Text=filter_3, TextSize=12, Justification=0)
textbox_3 = CreateTextBox(DefaultText=join, UpdateButton=False, showLabel=True)
eval_2 = Evaluate(F="if(x=0, \"0\", \"1\")", x=nullrep_2.Items)
hideshow_7 = HideShowElement(ElementToHideShow=tb_8, Show=bool, Collapse=True, Disable=False)
filter_4 = StreamFilter(Gate=eval_2, Stream0="基準線が選択されていません", Stream1=txt_3)
entwine = Entwine(Branch00=textbox_3, FlattenInputs=True)
tb_9 = CreateTextBlock(Text=filter_4, TextSize=12, Justification=0)
hideshow_8 = HideShowElement(ElementToHideShow=tb_9, Show=bool_2, Collapse=True, Disable=False)
adjustpos_4 = AdjustElementPositioning(ElementsToAdjust=[tb_8, tb_9, tb_3, tb_7, toggle_3, stack_3], AbsolutePositioning=False, HorizontalAlignment=1)
entwine_2 = Entwine(
    Branch00=tb_6,
    Branch01=stack,
    Branch02=stack_2,
    Branch03=tb_5,
    Branch04=tb_8,
    Branch05=expander_4,
    Branch06=expander,
    Branch07=tb_4,
    Branch08=tb_9,
    Branch09=expander_6,
    Branch010=tb_2,
    Branch011=tb_3,
    Branch012=expander_2,
    Branch013=expander_3,
    Branch014=expander_5,
    Branch015=tb,
    Branch016=stack_3,
    Branch017=tb_7,
    Branch018=toggle_3,
    FlattenInputs=True)
tabs = TabbedView(TabNames=panel, TabTextSize=Slider(20, range=0..100), Tab0=flatten(entwine_2), Tab1=flatten(entwine))
addelems = AddElements(Window=launchwin, Elements=flatten(tabs), DoVLChecking=True)  # -> AddedElements, ElementNames
rectangle = Rectangle(Plane=python.Center, XSize=dom, YSize=dom, Radius=0)  # -> Rectangle, Length
boundary = BoundarySurfaces(Edges=rectangle.Rectangle)
